# Grasshopper definition somefuturetree_v2.1.ghx (Grasshopper 1.0.8)
# plug-ins: Karamba3D, Human, LunchBox, NGon_RH8

number_slider = Slider(18, range=0..100)
multiplication = Multiplication(A=number_slider, B="4")

multiplication_2 = Multiplication(A=Slider(6, range=0..100), B="4")

# ----
# creating line network and mesh
# creating line network and mesh
# creating line network and mesh
# creating line network and mesh
curve = Curve(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)
curve_2 = Curve(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)
boundary_surfaces = BoundarySurfaces(Edges=curve_2)
diagrid_structure = DiagridStructure(Surface=boundary_surfaces, UDivisions=Slider(54, range=0..100), VDivisions=number_slider, Type=invert(True))  # -> StructureLines, StructureNodes
diagrid_structure_2 = DiagridStructure(Surface=boundary_surfaces, UDivisions=Slider(27, range=0..100), VDivisions=Slider(9, range=0..10), Type=True)  # -> StructureLines, StructureNodes
cluster = Cluster_2(curve_2=diagrid_structure.StructureLines, curve=curve)
curve_3 = Curve([curve, curve_2, cluster])
curve_4 = Curve([curve_2, diagrid_structure_2.StructureLines])
explode = Explode(Curve=curve_3, Recursive=True)  # -> flatten(Segments), Vertices
explode_2 = Explode(Curve=curve_4, Recursive=True)  # -> flatten(Segments), Vertices
line_line_intersection_karamba3d = LLInter(IntersectingLines=explode.Segments, LinesToIntersect=explode.Segments, LimitDistance_m=0.005)  # -> InterSecPoints, flatten(LineSubSegments)
line_line_intersection_karamba3d_2 = LLInter(IntersectingLines=explode_2.Segments, LinesToIntersect=explode_2.Segments, LimitDistance_m=0.005)  # -> InterSecPoints, flatten(LineSubSegments)

python_3_script = Python3Script(lines=line_line_intersection_karamba3d.LineSubSegments)  # -> out, dual, mesh; inputs lines: list of Line
# ---------- python_3_script: Python ----------
from compas.datastructures import Network, Mesh
from compas.geometry import dot_vectors, Vector

from compas_rhino.conversions import line_to_compas

lines = [line_to_compas(line) for line in lines]
mesh = Mesh.from_lines(lines, delete_boundary_face=True)

faces_to_delete = []
for fkey in mesh.faces():
    if len(mesh.face_vertices(fkey)) > 5:
        faces_to_delete.append(fkey)
    

for fkey in faces_to_delete:
    mesh.delete_face(fkey)

# Remove any orphaned vertices left behind by delete_face
mesh.remove_unused_vertices()
mesh.weld()


# Triangulate
for fkey in list(mesh.faces()):
    verts = mesh.face_vertices(fkey)
    if len(verts) == 4:
        # Quad → 2 triangles via diagonal
        p0 = mesh.vertex_coordinates(verts[0])
        p2 = mesh.vertex_coordinates(verts[2])
        if -0.1 < dot_vectors(Vector.from_start_end(p0, p2), Vector.Xaxis()) < 0.1:
            mesh.split_face(fkey, verts[1], verts[3])
        else:
            mesh.split_face(fkey, verts[0], verts[2])
    elif len(verts) > 4:
        # N-gon → fan triangulation from first vertex
        mesh.insert_vertex(fkey)

# for fkey in list(mesh.faces()):
#     mesh.face_attributes(fkey)["xi"] = 0.5

all_naked_vertices = []


# for u, v in mesh.edges():
#     # If the edge doesn't have a neighbor on both sides, it's a hole or boundary
#     if mesh.is_edge_on_boundary([u, v]):
#         all_naked_vertices.extend([u, v])

# # fixed_keys = list(set(all_naked_vertices))

# mesh.smooth_area(fixed=fixed_keys, kmax=10, damping=0.1, callback=None, callback_args=None)
# ---------- end python_3_script ----------
compas_draw = COMPASDraw(cg=python_3_script.mesh)  # -> rg
#   port cg: The COMPAS geometry or datastructure to be drawn.
#   port rg: The Rhino geometry object.
# ---------- compas_draw: Python ----------
# r: compas>=2.14.1
"""
Draws COMPAS geometry in Grasshopper.
"""

from typing import Any

import Grasshopper

from compas.scene import SceneObject


class CompasToRhinoGeometry(Grasshopper.Kernel.GH_ScriptInstance):
    def RunScript(self, cg):
        if not cg:
            return None

        return SceneObject(item=cg).draw()
# ---------- end compas_draw ----------

mesh_edges = MeshEdges(Mesh=compas_draw)  # -> AllE, NakedE
join_curves = JoinCurves(Curves=mesh_edges.NakedE, Preserve=False)
area = Area(Geometry=join_curves)  # -> Area, Centroid
sort_list = SortList(Keys=area.Area, ValuesValuesA=join_curves)  # -> Keys, reverse(ValuesValuesA)
split_list = SplitList(List=sort_list.ValuesValuesA, Index=Slider(1, range=0..100))  # -> ListA, ListB

curve_5 = Curve(split_list.ListB)
curve_6 = Curve(split_list.ListA)

mesh = Mesh(compas_draw)

deconstruct_mesh = DeconstructMesh(Mesh=mesh)  # -> Vertices, Faces, Colours, Normals
deconstruct = Deconstruct(Point=deconstruct_mesh.Vertices)  # -> XComponent, YComponent, ZComponent
construct_point = ConstructPoint(XCoordinate=deconstruct.XComponent, YCoordinate=deconstruct.YComponent, ZCoordinate=Slider(5, range=0..10))
anchor = Anchor(Point=deconstruct_mesh.Vertices, Target=construct_point, Strength=Slider(10, range=0..10))

point = Point([Point(86.52430207, 9.620222865, 0), Point(86.52430207, 19.24022287, 0), Point(48.04430207, 9.620222865, 0), Point(48.04430207, 19.24022287, 0)])
number_slider_2 = Slider(1000, range=0..1000)
distance = Distance(PointA=graft(point), PointB=deconstruct_mesh.Vertices)
sort_list_2 = SortList(Keys=distance, ValuesValuesA=deconstruct_mesh.Vertices)  # -> Keys, ValuesValuesA
explode_3 = Explode(Curve=curve_5, Recursive=invert(True))  # -> Segments, flatten(Vertices)
list_item = ListItem(List=sort_list_2.ValuesValuesA, Index=0, Wrap=True)  # -> Item, Item1
point_2 = Point(flatten([list_item.Item, list_item.Item1]))
anchorxyz = AnchorXYZ(Point=point_2, X=invert(False), Y=invert(False), Z=invert(False), Strength=number_slider_2)
anchorxyz_2 = AnchorXYZ(Point=explode_3.Vertices, X=invert(False), Y=invert(False), Z=invert(False), Strength=Slider(600, range=0..1000))

explode_4 = Explode(Curve=curve_6, Recursive=True)  # -> Segments, flatten(Vertices)
deconstruct_2 = Deconstruct(Point=explode_4.Vertices)  # -> XComponent, YComponent, ZComponent
construct_point_2 = ConstructPoint(XCoordinate=deconstruct_2.XComponent, YCoordinate=deconstruct_2.YComponent, ZCoordinate=Slider(5, range=0..10))
anchor_2 = Anchor(Point=explode_4.Vertices, Target=construct_point_2, Strength=number_slider_2)

smooth = Smooth(M=mesh, Strength=Slider(900, range=0..1000))

unit_z = UnitZ(Factor=Slider(5.5, range=0..10))

show = Show(G=mesh)
merge = Merge(Data1=show, Data2=anchorxyz, Data3=anchorxyz_2, Data4=anchor, Data5=smooth, Data6=anchor_2)  # -> flatten(Result)

solver = Solver(GoalObjects=merge, Reset=Button(), Threshold=Slider(0.0001, range=0..0.0001), Tolerance=0.0001, On=Toggle(True))  # -> I, V, O

cluster_2 = Cluster(tree=solver.O)
python_3_script_2 = Python3Script(mesh=cluster_2)  # -> out, lines, beam_pairs
# ---------- python_3_script_2: Python ----------
import os
import sys
import Rhino.Geometry as rg
import rhinoscriptsyntax as rs

_gh_path = ghenv.Component.OnPingDocument().FilePath
_gh_dir = os.path.dirname(_gh_path)
_this_dir = os.path.join(_gh_dir, "reciprocal_from_mesh")

if _this_dir not in sys.path:
    sys.path.insert(0, _gh_dir)
    sys.path.insert(0, _this_dir)

import importlib
import core_graph
importlib.reload(core_graph)

from core_graph import ReciprocalFrame
from compas_rhino.conversions import mesh_to_compas

# ============ GRASSHOPPER MAIN ============

if 'mesh' in dir() and mesh:
    if mesh:
        rhino_geo = rs.coercemesh(mesh)
        if isinstance(rhino_geo, rg.Mesh):
            mesh = mesh_to_compas(rhino_geo)
        else:
            mesh = mesh


    wt, we, wf, ws = 1.0, 0.3, 0.1, 0.0
    rf = ReciprocalFrame.from_mesh(mesh)  # Build graph only
    solver_info = rf.solve(weights=(wt, we, wf, ws), srf=srf)  # Then solve

    lines = rf.to_lines()

print(solver_info)

beam_pairs = []
for u, v in rf.edges():
    # Get the COMPAS Line object for each beam in the connection
    beam1 = rf.get_beam(u)
    beam2 = rf.get_beam(v)
    
    beam_pairs.append([beam1, beam2])

from ghpythonlib.treehelpers import list_to_tree

beam_pairs = list_to_tree(beam_pairs)
# ---------- end python_3_script_2 ----------
mesh_edges_2 = MeshEdges(Mesh=cluster_2)  # -> AllE, NakedE
compas_draw_2 = COMPASDraw(cg=python_3_script_2.lines)  # -> rg; same code as compas_draw
panel = Panel(python_3_script_2.out)
custom_preview_lineweights = CustomPreviewLineweights(
    Geometry=compas_draw_2,
    Shader=ColourSwatch(SwatchColor=RGB(0, 17, 255)),
    Thickness=Slider(3, range=0..10),
    Absolute=False)
custom_preview_lineweights_2 = CustomPreviewLineweights(
    Geometry=mesh_edges_2.AllE,
    Shader=ColourSwatch(SwatchColor=RGB(186, 186, 186)),
    Thickness=Slider(1.1, range=0..10),
    Absolute=False)

python_3_script_3 = Python3Script(lines=line_line_intersection_karamba3d_2.LineSubSegments)  # -> out, mesh; inputs lines: list of Line
# ---------- python_3_script_3: Python ----------
from compas.datastructures import Network, Mesh

from compas_rhino.conversions import line_to_compas

lines = [line_to_compas(line) for line in lines]
mesh = Mesh.from_lines(lines, delete_boundary_face=True)

faces_to_delete = []
for fkey in mesh.faces():
    if len(mesh.face_vertices(fkey)) > 4:
        faces_to_delete.append(fkey)
    

for fkey in faces_to_delete:
    mesh.delete_face(fkey)

# Remove any orphaned vertices left behind by delete_face
mesh.remove_unused_vertices()

# Triangulate
# for fkey in list(mesh.faces()):
#     x = mesh.face_center(fkey).x
#     # if (x > 82 or x<52):
#     verts = mesh.face_vertices(fkey)
#     if len(verts) == 4:
#         # Quad → 2 triangles via diagonal
#         mesh.split_face(fkey, verts[0], verts[2])
#     elif len(verts) > 4:
#         # N-gon → fan triangulation from first vertex
#         mesh.insert_vertex(fkey)

for fkey in list(mesh.faces()):
    mesh.face_attributes(fkey)["xi"] = 0.5
mesh.weld()
all_naked_vertices = []

# for u, v in mesh.edges():
#     # If the edge doesn't have a neighbor on both sides, it's a hole or boundary
#     if mesh.is_edge_on_boundary([u, v]):
#         all_naked_vertices.extend([u, v])

# # fixed_keys = list(set(all_naked_vertices))

# mesh.smooth_area(fixed=fixed_keys, kmax=10, damping=0.1, callback=None, callback_args=None)
# ---------- end python_3_script_3 ----------
compas_draw_3 = COMPASDraw(cg=python_3_script_3.mesh)  # -> rg; same code as compas_draw

triangulate = Triangulate(Mesh=compas_draw_3)  # -> Mesh, Count

weld_mesh = WeldMesh(Mesh=triangulate.Mesh, Angle=3.141592654)

move = Move(Geometry=weld_mesh, Motion=unit_z)  # -> Geometry, Transform

mesh_2 = Mesh(move.Geometry)
triangulate_2 = Triangulate(Mesh=mesh_2)  # -> Mesh, Count
python_3_script_4 = Python3Script(mesh=mesh_2)  # -> out, lines, beam_pairs; same code as python_3_script_2
mesh_edges_3 = MeshEdges(Mesh=mesh_2)  # -> AllE, NakedE
compas_draw_4 = COMPASDraw(cg=python_3_script_4.lines)  # -> rg; same code as compas_draw
panel_2 = Panel(python_3_script_4.out)
custom_preview_lineweights_3 = CustomPreviewLineweights(
    Geometry=compas_draw_4,
    Shader=ColourSwatch(SwatchColor=RGB(255, 0, 238)),
    Thickness=Slider(3, range=0..10),
    Absolute=False)
custom_preview_lineweights_4 = CustomPreviewLineweights(
    Geometry=mesh_edges_3.AllE,
    Shader=ColourSwatch(SwatchColor=RGB(46, 46, 46)),
    Thickness=Slider(1.1, range=0..10),
    Absolute=False)

# ==== cluster Cluster
tree = ClusterInput()
clean_tree = CleanTree(RemoveNulls=True, RemoveInvalid=True, RemoveEmpty=invert(False), Tree=tree)
list_item = ListItem(List=clean_tree, Index=0, Wrap=True)
i = ClusterOutput(list_item)

# ==== cluster Cluster_2
curve = ClusterInput()
curve_2 = ClusterInput()
midpoint = Midpoint(Curve=curve_2)
point_in_curve = PointInCurve(Point=midpoint, Curve=curve)  # -> Relationship, Point

equality = Equality(FirstNumber=point_in_curve.Relationship, SecondNumber="0")  # -> Equality, Inequality

cull_pattern = CullPattern(List=curve_2, CullPattern=equality.Equality)
list = ClusterOutput(cull_pattern)
